# Dynamo graph AFD_Tower_RandomList.dyn (Dynamo 2.10.1.3976)
# packages: Ampersand 2019.12.31

levels = DoubleSlider(55, range=1..100 step 1)
floor_height = DoubleSlider(450, range=400..600 step 50)
sequence = Sequence(amount=levels, step=floor_height)

# group: Utworzenie obrysów kondygnacji
byCoordinates = Point.ByCoordinates()
translate = Geometry.Translate(geometry=byCoordinates, zTranslation=sequence)
radius = DoubleSlider(3250, range=2000..10000 step 250)
radius_2 = DoubleSlider(4250, range=2000..5000 step 250)
code_block = CodeBlock(a=radius, b=radius_2, x=levels) { a..b..#x; }
code_block_2 = CodeBlock { 2; }
takeEveryNthItem = List.TakeEveryNthItem(list=code_block, n=code_block_2)
code_block_3 = CodeBlock { 1; }
takeEveryNthItem_2 = List.TakeEveryNthItem(list=code_block, n=code_block_2, offset=code_block_3)
reverse = List.Reverse(list=takeEveryNthItem_2)
join = List.Join(list0=takeEveryNthItem, list1=reverse)
byCenterPointRadius = Circle.ByCenterPointRadius(centerPoint=translate, radius=join)
sides = DoubleSlider(12, range=5..20 step 1)
regularPolygon = Polygon.RegularPolygon(circle=byCenterPointRadius, numberSides=sides)

code_block_4 = CodeBlock(x=sides) { 0..1..#x+1; }
pointAtParameter = Curve.PointAtParameter(curve=regularPolygon, param=code_block_4, lacing=CrossProduct)
flatten = List.Flatten(list=pointAtParameter@L2)
# note: Utworzenie kondygnacji (Levels) w Revicie
byElevation = Level.ByElevation(elevation=sequence)

# group: Utworzenie stropów
byPoints = PolyCurve.ByPoints(points=flatten)
floor_types = FloorTypes("Standard")
# note: Utworzenie polikrzywej
byOutlineTypeAndLevel = Floor.ByOutlineTypeAndLevel(outline=byPoints, floorType=floor_types, level=byElevation)

# note: Code Block, który eliminuje ścianę nad ostatnią kondygnacją
code_block_5 = CodeBlock(x=levels) { 0..x-2; }
watch = Watch(code_block_5)

# group: Utworzenie ścian pomiędzy stropami
curves = PolyCurve.Curves(polyCurve=regularPolygon)
getItemAtIndex = List.GetItemAtIndex(list=byElevation, index=watch)
wall_types = WallTypes("Curtain_Wall-Storefront")
byCurveAndHeight = Wall.ByCurveAndHeight(curve=curves, height=floor_height, level=getItemAtIndex, wallType=wall_types)

# group: Odsunięcie obrysów kondygnacji dla ściany osłonowej
radius_3 = DoubleSlider(100, range=100..500 step 50)
radius_4 = DoubleSlider(450, range=100..500 step 50)
seed = IntegerSlider(36, range=20..80 step 1)
randomList = Math.RandomList(amount=levels, value1=radius_3, value2=radius_4, seed=seed)
offset = Curve.Offset(curve=byCenterPointRadius, distance=randomList)

# group: Utworzenie listy punktów do "panelingu"
# note: Utworzenie powierzchni
byLoft = Surface.ByLoft(crossSections=offset)
code_block_6 = CodeBlock { 1; }
integer_slider = IntegerSlider(36, range=20..80 step 1)
code_block_7 = CodeBlock(v=integer_slider) { 0..1..#v; }
getIsoline = Surface.GetIsoline(surface=byLoft, isoDirection=code_block_6, parameter=code_block_7)
intersect = Geometry.Intersect(geometry=offset, other=getIsoline, lacing=CrossProduct)
flatten_2 = List.Flatten(list=intersect@L3)

# group: Utworzenie ściany osłonowej wykorzystującej "adaptive component"
pointgrid_toquadsets = Custom[[&] PointGrid.ToQuadSets](pointGrid=flatten_2)  # package Ampersand; Create groups of 4 items describing the "cells" of a rectangular grid of data. In the case of a grid of points, the output will be the set of points describing the corners of 4-pointed panels.
family_types = FamilyTypes("AFD_adaptive family:AFD_adaptive family")
byPoints_2 = AdaptiveComponent.ByPoints(points=pointgrid_toquadsets, familyType=family_types)
